# Dynamo graph Shadow.dyn (Dynamo 2.19.3.6394)

select_model_element = DSModelElementSelection()  # 1 picked in the model; graph input
select_site_boundary_elements = DSModelElementsSelection()  # nothing selected; graph input
levels = Levels("1FL")  # graph input
string = StringInput("""{
  "profile": "standard_8_16",
  "average_ground_level_elevation_m": 0.0,
  "measurement_height_m": 4.0,
  "latitude": 35.6812,
  "longitude": 139.7671,
  "site_latitude_deg": 35.6812,
  "solar_declination_deg": -23.439,
  "time_basis": "true_solar_time",
  "true_solar_start_time": "08:00",
  "true_solar_end_time": "16:00",
  "sun_time_step_minutes": 30,
  "true_north_deg": 0.0,
  "debug_log_enabled": true,
  "debug_log_dir": "debug_logs",
  "debug_log_filename": "latest_debug.json"
}""")  # graph input
python_script = Python(IN[0]=select_model_element, IN[1]=select_site_boundary_elements, IN[2]=levels, IN[3]=string)  # CPython3
# ---------- python_script.python (62 lines) ----------
# Dynamo Python Node / CPython3
# Minimal bootstrap: load dynamo_loader.py from the same folder as this .dyn file.

import clr
import os
import traceback

clr.AddReference("DynamoServices")
from Dynamo.Applications import DynamoRevit

LOADER_NAME = "dynamo_loader.py"


def get_workspace_file():
    try:
        return DynamoRevit.RevitDynamoModel.CurrentWorkspace.FileName
    except Exception:
        return None


try:
    workspace_file = get_workspace_file()
    workspace_dir = os.path.dirname(workspace_file) if workspace_file else None
    loader_path = os.path.join(workspace_dir, LOADER_NAME) if workspace_dir else None

    if not loader_path or not os.path.isfile(loader_path):
        OUT = {
            "success": False,
            "loader_name": LOADER_NAME,
            "workspace_file": workspace_file,
            "workspace_dir": workspace_dir,
            "loader_path": loader_path,
            "error": "dynamo_loader.py not found in the same folder as the .dyn file."
        }
    else:
        with open(loader_path, "r", encoding="utf-8-sig") as f:
            loader_code = f.read()

        loader_globals = {
            "__file__": loader_path,
            "__name__": "__dynamo_loader__",
            "IN": IN,
            "OUT": None,
            "WORKSPACE_FILE": workspace_file,
            "WORKSPACE_DIR": workspace_dir,
            "LOADER_PATH": loader_path,
        }

        try:
            loader_globals["UnwrapElement"] = UnwrapElement
        except Exception:
            pass

        exec(compile(loader_code, loader_path, "exec"), loader_globals)
        OUT = loader_globals.get("OUT", None)

except Exception:
    OUT = {
        "success": False,
        "loader_name": LOADER_NAME,
        "error": traceback.format_exc()
    }
# ----------------------------------------
watch = Watch(python_script)  # graph output
